# Grasshopper definition dev_renderer.ghx (Grasshopper 1.0.7)

# ---- group: Test Data
python = GhPythonScript()  # -> out, POINT_OUT, LINE_OUT, MESH_OUT
# ---------- python: Python ----------
vert_0 = [3, 2, 1]
vert_1 = [3, 10, 4]
vert_2 = [5, 6, 10]
vert_3 = [11, 0, 2]

########################################

#points = [vert_0]
#points = [vert_0, vert_1]
#points = [vert_0, vert_1, vert_2]
points = [vert_0, vert_1, vert_2, vert_3]


########################################

line_0 = [vert_0, vert_1]
line_1 = [vert_1, vert_2]
line_2 = [vert_2, vert_3]

#lines = [line_0]
#lines = [line_0, line_1]
lines = [line_0, line_1, line_2]

########################################

mesh_0 = [vert_0, vert_2, vert_1]
mesh_1 = [vert_0, vert_3, vert_2]
mesh_2 = [vert_0, vert_1, vert_3]
mesh_3 = [vert_1, vert_2, vert_3]


#meshes = [mesh_0]
#meshes = [mesh_0, mesh_1]
#meshes = [mesh_0, mesh_1, mesh_2]
meshes = [mesh_0, mesh_1, mesh_2, mesh_3]

########################################

POINT_OUT = points
LINE_OUT = lines
MESH_OUT = meshes
# ---------- end python ----------

# ----
# GH_Renderer
toggle = BooleanToggle(False)
python_2 = GhPythonScript(PATH="C:\Users\yoshioca\Documents\GH_Renderer", BOOL=toggle)  # -> out
# ---------- python_2: Python ----------
import sys

sys.path.append(PATH)

print(sys.path)
# ---------- end python_2 ----------
python_3 = GhPythonScript(POINT_IN=python.POINT_OUT)  # -> POINT_RENDERED, LINE_RENDERED, MESH_RENDERED; inputs POINT_IN: list, LINE_IN: list, MESH_IN: list
# ---------- python_3: Python ----------
from gh_renderer import renderer
reload(renderer)
rr = renderer.Renderer()

########################################

ghenv.Component.Message = 'RENDERER'

POINT_RENDERED = rr.render_points(POINT_IN)
LINE_RENDERED = rr.render_lines(LINE_IN)
MESH_RENDERED = rr.render_meshes(MESH_IN)
# ---------- end python_3 ----------
python_4 = GhPythonScript(LINE_IN=python.LINE_OUT)  # -> POINT_RENDERED, LINE_RENDERED, MESH_RENDERED; inputs POINT_IN: list, MESH_IN: list; same code as python_3
python_5 = GhPythonScript(MESH_IN=python.MESH_OUT)  # -> POINT_RENDERED, LINE_RENDERED, MESH_RENDERED; inputs POINT_IN: list, LINE_IN: list, MESH_IN: list; same code as python_3
panel = Panel(python_2)
panel_2 = Panel("""0
1
2
3""")
facen = FaceNormals(Mesh=python_5.MESH_RENDERED)  # -> Centers, Normals
tag = TextTag3D(Location=python_3.POINT_RENDERED, Text=panel_2, Size=1, Justification=7)
vdis = VectorDisplay(Anchor=facen.Centers, Vector=facen.Normals)
